# Grasshopper definition inflation.gh (Grasshopper 1.0.7)
# plug-ins: Kangaroo2 Components, MeshEdit Components

mesh = Mesh(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)
mesh_colours = MeshColours(
    Mesh=mesh,
    Colours=[RGB(220, 20, 60), RGB(255, 99, 71), RGB(255, 69, 0), RGB(165, 42, 42), RGB(255, 182, 193), RGB(250, 128, 114)])

# ---- group: RH_IN:iterations
number_slider = Slider(85, range=0..100)

# ----
livesoap = LiveSoap(
    Mesh=mesh,
    UseVolume=Toggle(True),
    VolumeChange=Slider(-1000, range=-1000..1000),
    Strength=Slider(10, range=0..10),
    Reset=number_slider)
zombiesolver = ZombieSolver(GoalObjects=livesoap, Threshold=1e-10, Tolerance=0.01, MaxIterations=number_slider)  # -> I, V, O
clean_tree = CleanTree(RemoveNulls=True, RemoveInvalid=True, RemoveEmpty=False, Tree=zombiesolver.O)
list_item = ListItem(List=clean_tree, Index=0, Wrap=True)
mesh_volume = MeshVolume(Mesh=list_item)  # -> Volume, Centroid
scale = Scale(Geometry=list_item, Center=mesh_volume.Centroid, Factor=Slider(1.453, range=0..10))  # -> Geometry, Transform
construct_plane = ConstructPlane(Origin=mesh_volume.Centroid, XAxis=Vector(1, 0, 0), YAxis=Vector(0, 1, 0))

# ---- group: RH_IN:scale_y
y = Slider(1.19, range=0..2)

# ---- group: RH_IN:scale_z
y_2 = Slider(1.19, range=0..2)

# ---- group: RH_IN:scale_x
x = Slider(1.068, range=0..2)

# ----
scale_nu = ScaleNU(Geometry=scale.Geometry, Plane=construct_plane, ScaleX=x, ScaleY=y, ScaleZ=1)  # -> Geometry, Transform
mesh_edges = MeshEdges(Mesh=scale_nu.Geometry)  # -> NakedEdges, InteriorEdges, NonManifoldEdges
mesh_colours_2 = MeshColours(Mesh=scale_nu.Geometry, Colours=RGBA(191, 255, 255, 15))
custom_preview = CustomPreview(
    Geometry=mesh_edges.InteriorEdges,
    Material={diffuse=RGB(221, 160, 221), emission=RGB(66, 48, 66), shine=0.5, specular=RGB(255, 255, 255), transparency=0})
c_script = CSharpScript(crv=mesh_edges.InteriorEdges)  # -> out, A; inputs crv: Curve, color: Color
# ---------- c_script: C# ----------
    var c = color.R + "," + color.G + "," + color.B;
    crv.SetUserString("color", c);
    A = crv;
# ---------- end c_script ----------

# ---- group: RH_OUT:shell
curve = Curve(c_script.A)

# ---- group: RH_OUT:mesh
mesh_2 = Mesh(mesh_colours)

mesh_3 = Mesh(mesh_colours_2)
